# Grasshopper definition Python_cosewave_GH_change varx.gh (Grasshopper 0.9.75)
# plug-ins: Python Interpreter

python = PythonScript(x=Slider(18, range=0..100))  # -> out, a, b; inputs x: Int32
# ---------- python: Python ----------
import math
import rhinoscriptsyntax as rs

if x is None: x=24  #if nothing is connected to x, set x to something

circles = []        #create a list. We will add IDs to it later on
radii=[]            #create another list....

for i in range(x):
    pt = (i,math.cos(i), 0)     #a tuple (here for a point)
    id1= rs.AddCircle(pt, 0.3)
    circles.append(id1)
    endPt = rs.PointAdd(pt, [0,0.3,0])  #move the point by the vector
    id2 = rs.AddLine(pt,endPt)
    radii.append(id2)
    
a=circles
b=radii
# ---------- end python ----------
