# Grasshopper definition recursion_GH_aggregation.gh (Grasshopper 0.9.75)
# plug-ins: Python Interpreter

brep = Brep(<brep referenced from the Rhino model>)
python = PythonScript(brep=brep, iterations=Slider(19, range=0..30))  # -> out, a; inputs iterations: Int32
# ---------- python: Python ----------
import rhinoscriptsyntax as rs

#get 5 points from each face of the brep, the first being the surface area centroid

def allPts(srf): #receive a surface
    
    border =  rs.DuplicateSurfaceBorder(srf) #pick that surface and get the border edges
    lines = rs.ExplodeCurves (border) #get the curves from that border; explode the border
    #return lines
    center = rs.SurfaceAreaCentroid(srf)
    
    allPts = []
    allPts.append(center[0]) #include first centroid point
    
    for line in lines: #look through all of our lines through a loop
    
        pt = rs.CurveEndPoint (line)
        allPts.append(pt)
    
    return allPts
    
    
    
def aggregate(obj,pointList):
    
    source = [pointList[0], pointList[1], pointList[2]] #list of 3 points
    target1 = [pointList[0], pointList[2], pointList[1]]
    target2 = [pointList[0], pointList[3], pointList[2]]
    
    newObject = rs.OrientObject(obj, source, target1) #takes 3 inputs/arguments; object id = guid
    return newObject



def recursiveAggregation(obj, gens, objList, count):
    
    allSrf = rs.ExplodePolysurfaces(obj)

    pointSet1 = allPts (allSrf[0]) #change to get different faces/surfaces
    pointSet2 = allPts (allSrf[1])
    pointSet3 = allPts (allSrf[2])
    
    if (count % 2 == 0):    #if the count is even, use pointSet1
        newObject = aggregate(obj, pointSet1)
        copy = rs.CopyObject(newObject)
        objList.append(copy)
    
    else:
        newObject = aggregate (obj, pointSet2)
    
        copy = rs.CopyObject(newObject)
        objList.append(copy)
    
    if(gens>0):
        recursiveAggregation(newObject, gens-1, objList, count+1)

        
    return objList
        


allNewObjs = []
count = 0


a = recursiveAggregation(brep, iterations, allNewObjs, count)
# ---------- end python ----------
debrep = DeconstructBrep()  # -> Faces, Edges, Vertices
panel = Panel(python.a)
_1 = Integer(1)
_2 = Integer(2)
_0 = Integer(0)
brep_2 = Brep(python.a)
item = ListItem(List=debrep.Faces, Index=_1, Wrap=True)
item_2 = ListItem(List=debrep.Faces, Index=_0, Wrap=True)
item_3 = ListItem(List=debrep.Faces, Index=_2, Wrap=True)
debrep_2 = DeconstructBrep(Brep=item_2)  # -> Faces, Edges, Vertices
_2_2 = Integer(2)
_1_2 = Integer(1)
_3 = Integer(3)
area = Area(Geometry=debrep_2.Faces)  # -> Area, Centroid
_0_2 = Integer(0)
item_4 = ListItem(List=debrep_2.Vertices, Index=_0_2, Wrap=True)
item_5 = ListItem(List=debrep_2.Vertices, Index=_1_2, Wrap=True)
item_6 = ListItem(List=debrep_2.Vertices, Index=_2_2, Wrap=True)
item_7 = ListItem(List=debrep_2.Vertices, Index=_3, Wrap=True)
merge = Merge(Data1=area.Centroid, Data2=item_4, Data3=item_5, Data4=item_6, Data5=item_7)  # -> flatten(Result)
panel_2 = Panel(merge)
