# Grasshopper definition python_test1_hex_array_variegated grid.gh (Grasshopper 0.9.75)
# plug-ins: Python Interpreter, PTComponentLibrary

ptplanar = PlanarGrid(
    BasePoint=Point(0, 0, 0),
    IDir=Vector(1, 0, 0),
    JDir=Vector(0, 1, 0),
    IDistance=Slider(35, range=0..100),
    JDistance=Slider(36, range=0..100),
    INumber=Slider(17, range=0..100),
    JNumber=Slider(19, range=0..100))
python = PythonScript(freq=Slider(17.821, range=0..20))  # -> out, a
# ---------- python: Python ----------
import rhinoscriptsyntax as rs
import math

#Sub waveGrid
rowSpace = 3
colSpace = 3
limit = 20
arrPoints = [limit, limit] #array to hold points
pi = math.pi
startTheta = 0
pt=[]

#rs.EnableRedraw(False)

for rows in rs.frange(0,limit,1):
    for cols in rs.frange(0,limit,1):
        for t in rs.frange(0,limit,1):
    
        #equate cols loop to angle slices around a circle ( angles in radians )
        #+ starting point on the circle
            rad = ((cols/limit)*(2*math.pi)) + startTheta
            x = cols*colSpace*(math.sin(rad * freq))
            y = rows*rowSpace
            z = 0
            pt.append(rs.AddPoint([x,y,z]))
            #rs.AddCircle(n,t)


    #iterate between rows
        startTheta = startTheta + ((2*math.pi)*(cols/limit))
rs.EnableRedraw(True)
a=pt
# ---------- end python ----------
# varigated grid based on trig functions; it is possible to combine this grid w/ curve component array below
ptclean = CleanGrid(Grid=python.a)
crv = Curve([<curve referenced from the Rhino model> x6])
# regular grid w/ sliders. be sure to set multiple curves (right click 'curve' battery) and select your component array within your Rhino canvas
ptmorph2d = Morph2D(Grid=ptplanar, PatternCurves=crv, Shift_i=1, Shift_j=1)
